# Grasshopper definition demo.gh (Grasshopper 1.0.7)
# plug-ins: gosand

# ----
# Color Palette (255 Colors)
number_slider = Slider(255, range=0..1000)
number_slider_2 = Slider(1, range=0..1)
range = Range(Domain="0.0 To 2.1", Steps=number_slider)
hsv = ColourHSV(Alpha=1, Hue=range, Saturation=number_slider_2, Value=number_slider_2)
rev = ReverseList(List=hsv)

# ----
# Crop Box on a 640x480 basis
number_slider_3 = Slider(60, range=0..100)
pt = ConstructPoint(XCoordinate=number_slider_3, YCoordinate=number_slider_3, ZCoordinate=0)
pt_2 = ConstructPoint(XCoordinate=Slider(550, range=0..1000), YCoordinate=Slider(400, range=0..1000), ZCoordinate=0)
rec_2pt = Rectangle2Pt(Plane=PlaneXY(0, 0, 0), PointA=pt, PointB=pt_2, Radius=0)  # -> Rectangle, Length

# ----
# Gonect Settings
panel = Panel("http://10.0.2.2:4777")
number_slider_4 = Slider(0, range=0..100)

# ----
# Contour Lines
# Contour curves could be created outside
# of the gonect component as well but this is
#  slow and blocking the UI. If you want a
# non-blocking experience activate them by
# increasing the distance parameter > 0
number_slider_5 = Slider(0, range=0..100)

number_slider_6 = Slider(350, range=0..1000)

# ----
# Activate Circle Detection
toggle = BooleanToggle(False)

getmesh = GetGosandMesh(
    Url=panel,
    Freq=Slider(500, range=0..1000),
    ColorPalette=rev,
    CroppingFrame=rec_2pt.Rectangle,
    ContourDistance=number_slider_5,
    CircleDetection=toggle)  # -> Mesh, ContourCurves, Circles

# ----
# Build a new mesh with average Z values across multiple meshes
number_slider_7 = Slider(30, range=0..100)
averagemesh = AverageMeshPoints(
    NumberOfMeshes=number_slider_7,
    Mesh=getmesh.Mesh,
    Reset=Button(),
    DimensionX=Slider(640, range=0..1000),
    DimensionY=Slider(480, range=0..1000))  # -> Mesh, NumberOfMeshes; disabled
panel_2 = Panel(averagemesh.NumberOfMeshes)

circle = Circle(getmesh.Circles)
panel_3 = Panel(circle)
preview = CustomPreview(Geometry=getmesh.ContourCurves, Material=ColourSwatch(SwatchColor=RGB(0, 0, 0)))
